# Dynamo graph visualisation.dyn (Dynamo 2.1.0.7500)

byStartPointEndPoint = Line.ByStartPointEndPoint()  # unwired: startPoint, endPoint
file_path = Filename("路径\Routen3.xlsx")
file_from_path = FileObject(path=file_path)
string = StringInput("Sheet1")
importExcel = Data.ImportExcel(file=file_from_path, sheetName=string)
number = DoubleInput(1)
dropItems = List.DropItems(list=importExcel, amount=number)
transpose = List.Transpose(lists=dropItems)
code_block = CodeBlock(a=transpose) { a[0]; a[1]; a[2]; a[3]; a[4]; a[5]; }
code_block_2 = CodeBlock(x1=code_block.out0) { x1; }
code_block_3 = CodeBlock(y1=code_block.out1) { y1; }
code_block_4 = CodeBlock(z1=code_block.out4) { z1; }
byCoordinates = Point.ByCoordinates(x=code_block_2, y=code_block_3, z=code_block_4)
code_block_5 = CodeBlock(x2=code_block.out2) { x2; }
code_block_6 = CodeBlock(y2=code_block.out3) { y2; }
code_block_7 = CodeBlock(z2=code_block.out5) { z2; }
byCoordinates_2 = Point.ByCoordinates(x=code_block_5, y=code_block_6, z=code_block_7)
list_create = List.Create(item0=byCoordinates, item1=byCoordinates_2)
transpose_2 = List.Transpose(lists=list_create)
family_types = FamilyTypes("管道:管道")
byPoints = AdaptiveComponent.ByPoints(points=transpose_2, familyType=family_types)
setParameterByName = Element.SetParameterByName()  # unwired: element, parameterName, value
